# Dynamo graph dynamo clash.dyn (Dynamo 2.0.3.8810)

XY = Plane.XY()
toCoordinateSystem = Plane.ToCoordinateSystem(plane=XY)
origin = Point.Origin()
ZAxis = Vector.ZAxis()
get_project_locations = Custom[Get Project Locations]()  # Works only in Revit 2018 and later. Retrieves the project positions of the given document in the Survey Coordinate System. (Coordinates of Internal origin, project base point and survey point)
ROTATION = CodeBlock(pbp=get_project_locations.Project_Base_Point) { pbp[1]; }
rotate = CoordinateSystem.Rotate(coordinateSystem=toCoordinateSystem, origin=origin, axis=ZAxis, degrees=ROTATION)
origin_2 = Point.Origin()
X = Point.X(point=get_project_locations.Internal_Origin)
Y = Point.Y(point=get_project_locations.Internal_Origin)
code_block = CodeBlock(x=X, y=Y) { E_W_Disp = x*-1; N_S_Disp = y*-1; }
PBP = CodeBlock(pbp=get_project_locations.Project_Base_Point) { pbp[0]; }
Z = Point.Z(point=PBP)
code_block_2 = CodeBlock(z=Z) { ELEV_Disp = z*-1; }
byCartesianCoordinates = Point.ByCartesianCoordinates(cs=rotate, x=code_block.E_W_Disp, y=code_block.N_S_Disp, z=code_block_2)
byTwoPoints = Vector.ByTwoPoints(start=origin_2, end=byCartesianCoordinates)
distanceTo = Geometry.DistanceTo(geometry=origin_2, other=byCartesianCoordinates)
translate = CoordinateSystem.Translate(coordinateSystem=rotate, direction=byTwoPoints, distance=distanceTo)
file_path = Filename(".\COND_ARQ.xlsx")
file_from_path = FileObject(path=file_path)
boolean = BoolSelector(true)
get_worksheet_names = Custom[Get Worksheet Names](filePath=file_path, runIt=boolean)  # This node will query an Excel file and return a list of sheet names that it contains.
code_block_3 = CodeBlock(X=get_worksheet_names) { X[2]; }
code_block_4 = CodeBlock { true; false; }
importExcel = Data.ImportExcel(file=file_from_path, sheetName=code_block_3, readAsStrings=code_block_4.out0, showExcel=code_block_4.out1)
code_block_5 = CodeBlock { 1; }
dropItems = List.DropItems(list=importExcel, amount=code_block_5)
transpose = List.Transpose(lists=dropItems)
code_block_6 = CodeBlock(X=importExcel) { X[0]; }
code_block_7 = CodeBlock(headers=code_block_6)
# ---------- code_block_7.designscript (8 lines) ----------
DSCore.List.IndexOf(headers, "Clash Name");
DSCore.List.IndexOf(headers, "Status");
DSCore.List.IndexOf(headers, "Grid Location");
DSCore.List.IndexOf(headers, "Date Found");
DSCore.List.IndexOf(headers, "Clash Point");
DSCore.List.IndexOf(headers, "Item ID_1");
DSCore.List.IndexOf(headers, "Item ID_2");
DSCore.List.IndexOf(headers, "Level");
# ----------------------------------------
code_block_8 = CodeBlock(list=transpose, I1=code_block_7.out0, I2=code_block_7.out1, I3=code_block_7.out2, I4=code_block_7.out3, I5=code_block_7.out4, I6=code_block_7.out5, I7=code_block_7.out6, I8=code_block_7.out7)
# ---------- code_block_8.designscript (8 lines) ----------
names = list[I1];
status = list[I2];
grid_loc = list[I3];
date = list[I4];
point = list[I5];
id1 = list[I6];
id2 = list[I7];
level = list[I8];
# ----------------------------------------
code_block_9 = CodeBlock { "x:"; ",  y:"; ",  z:"; }
split = String.Split(str=code_block_8.point, separater0=code_block_9.out0, separater1=code_block_9.out1, separater2=code_block_9.out2)
toNumber = String.ToNumber(str=split)
convert_between_units = DynamoConvert(toNumber, MeasurementType="Length", FromConversion="Meters", ToConversion="Millimeters")
transpose_2 = List.Transpose(lists=convert_between_units)
code_block_10 = CodeBlock(list=transpose_2) { x = list[0]; y = list[1]; z = list[2]; }
byCartesianCoordinates_2 = Point.ByCartesianCoordinates(cs=translate, x=code_block_10.x, y=code_block_10.y, z=code_block_10.z, lacing=Longest)
family_types = FamilyTypes()  # nothing selected
byPoints = AdaptiveComponent.ByPoints(points=byCartesianCoordinates_2, familyType=family_types, lacing=Longest)
code_block_11 = CodeBlock { "Clash Name"; "Status"; "Grid Location"; "Clash X"; "Clash Y"; "Clash Z"; "Item ID_1"; "Item ID_2"; "Clash Level"; }
setParameterByName = Element.SetParameterByName(element=byPoints, parameterName=code_block_11.out2, value=code_block_8.grid_loc)
setParameterByName_2 = Element.SetParameterByName(element=byPoints, parameterName=code_block_11.out5, value=code_block_10.z)
setParameterByName_3 = Element.SetParameterByName(element=byPoints, parameterName=code_block_11.out0, value=code_block_8.names)
setParameterByName_4 = Element.SetParameterByName(element=byPoints, parameterName=code_block_11.out3, value=code_block_10.x)
setParameterByName_5 = Element.SetParameterByName(element=byPoints, parameterName=code_block_11.out1, value=code_block_8.status)
setParameterByName_6 = Element.SetParameterByName(element=byPoints, parameterName=code_block_11.out4, value=code_block_10.y)
code_block_12 = CodeBlock { ":  "; 0; }
split_2 = String.Split(str=code_block_8.id1, separater0=code_block_12.out0)
removeItemAtIndex = List.RemoveItemAtIndex(list=split_2@L2, indices=code_block_12.out1)
flatten = List.Flatten(list=removeItemAtIndex)
toNumber_2 = String.ToNumber(str=flatten)
setParameterByName_7 = Element.SetParameterByName(element=byPoints, parameterName=code_block_11.out6, value=toNumber_2)
split_3 = String.Split(str=code_block_8.id2, separater0=code_block_12.out0)
removeItemAtIndex_2 = List.RemoveItemAtIndex(list=split_3@L2, indices=code_block_12.out1)
flatten_2 = List.Flatten(list=removeItemAtIndex_2)
toNumber_3 = String.ToNumber(str=flatten_2)
setParameterByName_8 = Element.SetParameterByName(element=byPoints, parameterName=code_block_11.out7, value=toNumber_3)
setParameterByName_9 = Element.SetParameterByName(element=byPoints, parameterName=code_block_11.out8, value=code_block_8.level)
